# Grasshopper definition hops_sample.gh (Grasshopper 1.0.7)
# plug-ins: Hops

# 頂部節点
# 外周多角形
crv = Curve(<curve referenced from the Rhino model>)
pt = Point(<point referenced from the Rhino model>)
hops = Hops(
    PL=crv,
    P=pt,
    CacheResultsInMemory=False,
    CacheSolveResults=False,
    RemoteDefinitionLocation="http://127.0.0.1:5000/tessellate",
    RemoteSolveVersion=(0, 1, 0),
    ShowInput_Enabled=False,
    ShowInput_Path=False,
    SynchronousSolve=True)
medges = MeshEdges(Mesh=hops)  # -> NakedEdges, InteriorEdges, NonManifoldEdges
panel = Panel(hops)
pipe = Pipe(Curve=[medges.NakedEdges, medges.InteriorEdges, medges.NonManifoldEdges], Radius=1, Caps=0)
preview = CustomPreview(Geometry=pipe, Material=ColourSwatch(SwatchColor=RGB(121, 148, 166)))
